# Grasshopper definition test_main_2.gh (Grasshopper 1.0.8)

panel = Panel("0.000,0.000,0.000;-81.061,109.547,0.000;-5.574,172.908,0.000;95.258,61.404,0.000;0.000,0.000,0.000")
envelope_vertices = GetString(panel, AtLeast=1, AtMost=1, TreeAccess=False)
envelope_setback = GetString(Slider(2, range=2..10), AtLeast=1, AtMost=1, TreeAccess=False)
no_of_floors = GetNumber(Slider(3, range=0..10), AtLeast=1, AtMost=1, Maximum=1.797693135e+308, Minimum=-1.797693135e+308, TreeAccess=False)
floor_height = GetNumber(Slider(3, range=0..10), AtLeast=1, AtMost=1, Maximum=1.797693135e+308, Minimum=-1.797693135e+308, TreeAccess=False)
tmatch = MatchText(Text=envelope_vertices, Pattern="0", Case=True)
gate = StreamGate(Stream=envelope_vertices, Gate=tmatch)  # -> Target0, Target1
series = Series(Start=floor_height, Step=floor_height, Count=no_of_floors)
Z = UnitZ(Factor=series)
split = TextSplit(Text=gate.Target0, Separators=";")
pline = PolyLine(Vertices=split, Closed=True)
offset = OffsetCurve(Curve=pline, Distance=expr("-x", envelope_setback), Corners=1)
move = Move(Geometry=offset, Motion=Z)  # -> Geometry, Transform
mjoin = MeshJoin(Meshes=move.Geometry)
mcol = MeshColours(Mesh=mjoin, Colours=ColourSwatch(SwatchColor=RGBA(217, 168, 72, 169)))

# ---- group: RH_OUT:meshout
mesh = Mesh(mcol)
